# Grasshopper definition hst_discover.gh (Grasshopper 1.0.7)

# ---- group: 1. connect to server
connect = Connect(connect=Button())  # -> status, connections
# ---------- connect: Python ----------
import urllib2, socket
import sys, math, os, json

t_o = 1

if not connect:
    local_file = ghenv.Component.OnPingDocument().FilePath
    if local_file == None:
        status = "Please save your Grasshopper file before connecting to Discover server"
    else:
        file_path = local_file.split("\\")
        file_dir = "\\".join(file_path)#[:-1])
        file_name = file_path[-1].split(".")[0]
        
        print(file_name)
        
        try:
            response = urllib2.urlopen('http://127.0.0.1:5000/api/v1.0/connect/' + urllib2.quote(file_name), timeout=t_o)
            html = response.read()
            result = json.loads(html)
            status = result["status"]
            connections = result["connections"]
        except urllib2.URLError:
            status = "Server not found"
        except socket.timeout:
            status = "Server timed out"
# ---------- end connect ----------
panel = Panel(connect.status)
bang = ExplodeTree(Data=simplify(graft(connect.connections)))  # -> Branch0, Branch1

# ----
file = ReadFile(File=bang.Branch0, PerLineParse=True)
get_inputs = GetInputs(connection=file)  # -> out, inputs
# ---------- get_inputs: Python ----------
import time, json, urllib2, socket

t_o = 1

try:
    response = urllib2.urlopen('http://127.0.0.1:5000/api/v1.0/get_inputs/', timeout=t_o)# + urllib2.quote(file_dir))
    html = response.read()
    inputs = json.loads(html)
    print "Received inputs from server"
except urllib2.URLError:
    inputs = []
    print "Could not connect to server"
except socket.timeout:
    inputs = []
    print "Server timed out"

#print inputs
# ---------- end get_inputs ----------
python = GhPythonScript(x=get_inputs.inputs)  # -> flatten(a)
# ---------- python: Python ----------
a = x
# ---------- end python ----------

# ---- group: 4. capture screenshot
file_2 = ReadFile(File=bang.Branch1, PerLineParse=True)
screenshot = Screenshot(connection=file_2)  # -> out; inputs connection: list
# ---------- screenshot: Python ----------
import time, json, urllib2, socket
import Rhino
import System
import scriptcontext

t_o = 1

def make_view(view_name, views):
        new_view = views.Add(view_name, Rhino.Display.DefinedViewportProjection.Perspective, System.Drawing.Rectangle(0,0,800, 600), True)
        new_vp = new_view.MainViewport
        new_vp.WorldAxesVisible = False
        new_vp.ZoomExtents()
        return new_view

def capture_screenshot():
    views = Rhino.RhinoDoc.ActiveDoc.Views
    view_name = "Discover"
    
    view_list = views.GetViewList(True, True)
    view_names = [vp.MainViewport.Name for vp in view_list]
    
    if view_name not in view_names:
        view = make_view(view_name, views)
    else:
        view = view_list[view_names.index(view_name)]
    
    bitmap = view.CaptureToBitmap(False, False, False)
    
    file_path = ghenv.Component.OnPingDocument().FilePath.split("\\")
    
    req = urllib2.Request('http://127.0.0.1:5000/api/v1.0/get_ss_path/')
    req.add_header('Content-Type', 'application/json')
    
    response = urllib2.urlopen(req, timeout=t_o)
    html = response.read()
    result = json.loads(html)
    
    if result["status"] == "success":
        path = result["path"]
    
    save_dir = ".".join([path, "png"])
    
    print "Saved screenshot to", save_dir
    
    bitmap.Save(save_dir)

def ping_server():
    try:
        req = urllib2.Request('http://127.0.0.1:5000/api/v1.0/ss_done/')
        req.add_header('Content-Type', 'application/json')
        
        response = urllib2.urlopen(req, timeout=t_o)
        html = response.read()
        result = json.loads(html)
    
        print result["status"]
    
    except urllib2.URLError:
        print "Could not connect to server"

try:
    req = urllib2.Request('http://127.0.0.1:5000/api/v1.0/job_running/')
    req.add_header('Content-Type', 'application/json')
    
    response = urllib2.urlopen(req, timeout=t_o)
    html = response.read()
    result = json.loads(html)
    
    if result:
        capture_screenshot()
        ping_server()
    else:
        print "No job running"
        
except urllib2.URLError:
    print "Could not connect to server"
except socket.timeout:
    print "Server timed out"
# ---------- end screenshot ----------
panel_2 = Panel(screenshot)

# ----
panel_3 = Panel(python)
item = ListItem(List=python, Index=Slider(3, range=0..14), Wrap=True)
item_2 = ListItem(List=python, Index=Slider(3, range=0..14), Wrap=True)
panel_4 = Panel("""Fixed Tilt
Single Axis Tracker""")
panel_5 = Panel("""Bifacial
Monofacial""")
num = Number(item)

module_efficiency = Slider(0.195467, range=0..1)
modules_per_rack = Slider(81, range=0..100)
modules_per_pile = Slider(7.36, range=0..10)
jinko_monofacial = Slider(0, range=0..1)
module_price = Slider(0.29, range=0..1)
acres_per_kw = Slider(0.12, range=0..10)
ac_capacity = Slider(10040, range=1..50000)
racking_sat = Slider(1, range=0..1)
dcac_ratio = Slider(1.21, range=1..2)
bifaciality = Slider(0.7, range=0..1)
azimuth = Slider(176, range=175..185)
portrait = Slider(1, range=0..1)
gcr = Slider(0.55, range=0..1)
tilt = Slider(0, range=0..90)

num_2 = Number(item_2)
item_3 = ListItem(List=panel_5, Index=num, Wrap=True)
item_4 = ListItem(List=python, Index=Slider(3, range=0..14), Wrap=True)
item_5 = ListItem(List=panel_4, Index=num_2, Wrap=True)
item_6 = ListItem(List=python, Index=Slider(4, range=0..21), Wrap=True)
item_7 = ListItem(List=python, Index=Slider(3, range=0..4), Wrap=True)
item_8 = ListItem(List=python, Index=Slider(4, range=0..14), Wrap=True)
item_9 = ListItem(List=python, Index=Slider(0, range=0..4), Wrap=True)
item_10 = ListItem(List=python, Index=Slider(1, range=0..4), Wrap=True)
item_11 = ListItem(List=python, Index=Slider(2, range=0..14), Wrap=True)

num_3 = Number(item_8)
pt = ConstructPoint(XCoordinate=Slider(0, range=-10..10), YCoordinate=Slider(16, range=0..20), ZCoordinate=0)
format = Format(Format="Acres/MWdc = {0:0.000}", Culture=127, Data0=num_3)
tag = TextTag3D(Location=pt, Text=format, Size=1, Justification=7)

num_4 = Number(item_4)
pt_2 = ConstructPoint(XCoordinate=Slider(0, range=-10..10), YCoordinate=Slider(14, range=-1..20), ZCoordinate=0)
format_2 = Format(Format="GCR = {0:0.000}", Culture=127, Data0=num_4)
tag_2 = TextTag3D(Location=pt_2, Text=format_2, Size=1, Justification=7)

pt_3 = ConstructPoint(XCoordinate=Slider(0, range=-10..10), YCoordinate=Slider(12, range=-1..20), ZCoordinate=0)
format_3 = Format(Format="Modules = {0}", Culture=127, Data0=item_3)
tag_3 = TextTag3D(Location=pt_3, Text=format_3, Size=1, Justification=7)

num_5 = Number(item_7)
pt_4 = ConstructPoint(XCoordinate=Slider(0, range=-10..10), YCoordinate=Slider(18, range=0..20), ZCoordinate=0)
format_4 = Format(Format="AC Size, kWac = {0:0.0}", Culture=127, Data0=num_5)
tag_4 = TextTag3D(Location=pt_4, Text=format_4, Size=1, Justification=7)

num_6 = Number(item_11)
pt_5 = ConstructPoint(XCoordinate=Slider(0, range=-10..10), YCoordinate=Slider(20, range=0..20), ZCoordinate=0)
format_5 = Format(Format="DC/AC Ratio = {0:0.000}", Culture=127, Data0=num_6)
tag_5 = TextTag3D(Location=pt_5, Text=format_5, Size=1, Justification=7)

num_7 = Number(item_6)
pt_6 = ConstructPoint(XCoordinate=Slider(0, range=-10..10), YCoordinate=Slider(8, range=-1..20), ZCoordinate=0)
tag_6 = TextTag3D(Location=pt_6, Text="--------------------------", Size=1, Justification=7)

pt_7 = ConstructPoint(XCoordinate=Slider(0, range=-10..10), YCoordinate=Slider(10, range=-1..20), ZCoordinate=0)
format_6 = Format(Format="Racking = {0}", Culture=127, Data0=item_5)
tag_7 = TextTag3D(Location=pt_7, Text=format_6, Size=1, Justification=7)

num_8 = Number(item_9)
pt_8 = ConstructPoint(XCoordinate=Slider(0, range=-10..10), YCoordinate=Slider(24, range=0..30), ZCoordinate=0)
format_7 = Format(Format="Tilt = {0:0.0}", Culture=127, Data0=num_8)
tag_8 = TextTag3D(Location=pt_8, Text=format_7, Size=1, Justification=7)

num_9 = Number(item_10)
pt_9 = ConstructPoint(XCoordinate=Slider(0, range=-10..10), YCoordinate=Slider(22, range=0..30), ZCoordinate=0)
format_8 = Format(Format="Azimuth = {0:0.0}", Culture=127, Data0=num_9)
tag_9 = TextTag3D(Location=pt_9, Text=format_8, Size=1, Justification=7)

merge = Merge(
    Data1=tilt,
    Data2=azimuth,
    Data3=dcac_ratio,
    Data4=ac_capacity,
    Data5=acres_per_kw,
    Data6=gcr,
    Data7=jinko_monofacial,
    Data8=racking_sat)

# ---- group: hst_model
python_2 = GhPythonScript(features=python)  # -> data; inputs features: list
# ---------- python_2: Python ----------
import pickle

data = pickle.dumps(features)
print data
# ---------- end python_2 ----------
python_3 = PythonScript()  # -> path
# ---------- python_3: Python ----------
import pickle

import sys
sys.path.append(path)

path = ghenv.LocalScope.ghdoc.Path
path = path.split("\\")
path = "\\".join(path[:-3]) + "\\" + "hst_exploration" + "\\"
# ---------- end python_3 ----------
python_4 = PythonScript(path=python_3, data=python_2, run=Toggle(True))  # -> out, output; inputs data: list
# ---------- python_4: Python ----------
if run:
        
    import subprocess
    import pickle
    
    try:
        startupinfo = subprocess.STARTUPINFO()
        startupinfo.dwFlags |= subprocess.STARTF_USESHOWWINDOW
        output = subprocess.check_output(["py37", path + "predict.py", data], startupinfo=startupinfo)
    except subprocess.CalledProcessError as e:
        print "error"
        print e
# ---------- end python_4 ----------
python_5 = GhPythonScript(output=python_4.output)  # -> out, predictions
# ---------- python_5: Python ----------
import pickle

predictions = pickle.loads(output)
# ---------- end python_5 ----------
panel_6 = Panel(python_4.output)
panel_7 = Panel(python_5.out)

python_6 = GhPythonScript(features=python)  # -> data; inputs features: list; same code as python_2
python_7 = PythonScript()  # -> path
# ---------- python_7: Python ----------
import pickle

import sys
sys.path.append(path)

path = ghenv.LocalScope.ghdoc.Path
path = path.split("\\")
path = "\\".join(path[:-3]) + "\\" + "SolarSimulationSuite" + "\\"
# ---------- end python_7 ----------
python_8 = PythonScript(path=python_7, data=python_6, run=Toggle(True))  # -> out, output; inputs data: list
# ---------- python_8: Python ----------
if run:
        
    import subprocess
    import pickle
    
    try:
        startupinfo = subprocess.STARTUPINFO()
        startupinfo.dwFlags |= subprocess.STARTF_USESHOWWINDOW
        output = subprocess.check_output(["py37", path + "sam_predict.py", data], startupinfo=startupinfo)
    except subprocess.CalledProcessError as e:
        print "error"
        print e
# ---------- end python_8 ----------
python_9 = GhPythonScript(output=python_8.output)  # -> out, predictions; same code as python_5
panel_8 = Panel(python_8.output)
panel_9 = Panel(python_9.out)

# ----
item_12 = ListItem(List=python_5.predictions, Index=Slider(0, range=0..4), Wrap=True)
item_13 = ListItem(List=python_5.predictions, Index=Slider(1, range=0..4), Wrap=True)
item_14 = ListItem(List=python_5.predictions, Index=Slider(2, range=0..4), Wrap=True)
item_15 = ListItem(List=python_5.predictions, Index=Slider(3, range=0..4), Wrap=True)

num_10 = Number(item_14)
pt_10 = ConstructPoint(XCoordinate=Slider(0, range=-10..10), YCoordinate=Slider(2, range=0..10), ZCoordinate=0)
format_9 = Format(Format="Specific Yield = {0:0} kWh/kWp", Culture=127, Data0=num_10)
tag_10 = TextTag3D(Location=pt_10, Text=format_9, Size=1, Justification=7)

num_11 = Number(item_12)
pt_11 = ConstructPoint(XCoordinate=Slider(0, range=-10..10), YCoordinate=Slider(6, range=0..10), ZCoordinate=0)
format_10 = Format(Format="LCOE = ${0:0.00}", Culture=127, Data0=num_11)
tag_11 = TextTag3D(Location=pt_11, Text=format_10, Size=1, Justification=7)

num_12 = Number(item_13)
pt_12 = ConstructPoint(XCoordinate=Slider(0, range=-10..10), YCoordinate=Slider(4, range=0..10), ZCoordinate=0)
format_11 = Format(Format="CAPEX = ${0:0.0} M", Culture=127, Data0=num_12)
tag_12 = TextTag3D(Location=pt_12, Text=format_11, Size=1, Justification=7)

num_13 = Number(item_15)
pt_13 = ConstructPoint(XCoordinate=Slider(0, range=-10..10), YCoordinate=Slider(0, range=0..10), ZCoordinate=0)
format_12 = Format(Format="Feasible = {0:0}", Culture=127, Data0=num_13)
tag_13 = TextTag3D(Location=pt_13, Text=format_12, Size=1, Justification=7)

# ---- group: 3. send outputs to server
merge_2 = Merge(Data1=python_5.predictions)
send_outputs = SendOutputs(outputs=merge_2)  # -> out; inputs outputs: list
# ---------- send_outputs: Python ----------
import time, json, urllib2, socket

t_o = 1

#try:
#    response = urllib2.urlopen('http://127.0.0.1:5000/api/v1.0/set_outputs/' + urllib2.quote(file_dir))
#    html = response.read()
#    inputs = json.loads(html)
#except urllib2.URLError:
#    inputs = []
#    print "could not connect to server"

try:
    req = urllib2.Request('http://127.0.0.1:5000/api/v1.0/set_outputs/')
    req.add_header('Content-Type', 'application/json')
    
    response = urllib2.urlopen(req, json.dumps(outputs), timeout=t_o)
    html = response.read()
    result = json.loads(html)

    print result["status"]

except urllib2.URLError:
    print "could not connect to server"
except socket.timeout:
    print "Server timed out"
# ---------- end send_outputs ----------
panel_10 = Panel(send_outputs)
