# Grasshopper definition pv_discover.gh (Grasshopper 1.0.7)
# plug-ins: Discover

discover = Discover(Connect=Button())  # -> Status, Active
continuous = Continuous(Name="ac_capacity", Range="2 to 20", Count=1, Message=discover.Active, Input_id="zpBnNu5E")  # -> Status, Values
multiplication = Multiplication(A=continuous.Values, B="2510")
panel = Panel(discover.Status)
continuous_2 = Continuous(Name="gcr", Range="0.23 to 0.69", Count=1, Input_id="ZaDJzaJJ")  # -> Status, Values
continuous_3 = Continuous(Name="dcac_ratio", Range="1 to 2", Count=1, Message=discover.Active, Input_id="ZMHklNuE")  # -> Status, Values
continuous_4 = Continuous(Name="azimuth", Range="170 to 190", Count=1, Message=discover.Active, Input_id="QIDPl8wa")  # -> Status, Values
continuous_5 = Continuous(Name="tilt", Range="0 to 45", Count=1, Message=discover.Active, Input_id="ailZi0y4")  # -> Status, Values
merge = Merge(
    Data1=continuous_5.Values,
    Data2=continuous_4.Values,
    Data3=continuous_3.Values,
    Data4=multiplication,
    Data5=continuous_2.Values)

# ---- group: hst_model
python = GhPythonScript(features=merge)  # -> data; inputs features: list
# ---------- python: Python ----------
import pickle

data = pickle.dumps(features)
print data
# ---------- end python ----------
python_2 = PythonScript()  # -> path
# ---------- python_2: Python ----------
import pickle

import sys
sys.path.append(path)

path = ghenv.LocalScope.ghdoc.Path
path = path.split("\\")
path = "\\".join(path[:-3]) + "\\" + "hst_exploration" + "\\"
# ---------- end python_2 ----------
python_3 = PythonScript(path=python_2, data=python, run=Toggle(True))  # -> out, output; inputs data: list
# ---------- python_3: Python ----------
if run:
        
    import subprocess
    import pickle
    
    try:
        startupinfo = subprocess.STARTUPINFO()
        startupinfo.dwFlags |= subprocess.STARTF_USESHOWWINDOW
        output = subprocess.check_output(["python", path + "predict.py", data], startupinfo=startupinfo)
    except subprocess.CalledProcessError as e:
        print "error"
        print e
# ---------- end python_3 ----------
panel_2 = Panel(python_3.output)
python_4 = GhPythonScript(output=python_3.output)  # -> out, predictions
# ---------- python_4: Python ----------
import pickle

predictions = pickle.loads(output)
# ---------- end python_4 ----------
panel_3 = Panel(python_4.out)

# ----
bang = ExplodeTree(Data=simplify(graft(python_4.predictions)))  # -> Branch0, Branch1
panel_4 = Panel(bang.Branch0)
division = Division(A=panel_4, B="1000000")
panel_5 = Panel(bang.Branch1)
panel_6 = Panel(division)
objective = Objective(Name="EPC cost", Value=panel_6, Goal="Minimize")
objective_2 = Objective(Name="Specific Yield", Value=panel_5, Goal="Minimize")
