# Grasshopper definition box.gh (Grasshopper 1.0.7)
# plug-ins: Discover

discover = Discover(Connect=Button())  # -> Status, Active
panel = Panel(discover.Status)
screenshot = CaptureScreenshot(ViewName="Perspective", Active=discover.Active)
continuous = Continuous(Name="Input", Range="0 to 10", Count="3", Input_id="ZPIPwbkN")  # -> Status, Values
bang = ExplodeTree(Data=simplify(graft(continuous.Status)))  # -> Branch0, Branch1, Branch2
pt = ConstructPoint(XCoordinate=0, YCoordinate=0, ZCoordinate=0)
pt_2 = ConstructPoint(XCoordinate=bang.Branch0, YCoordinate=bang.Branch1, ZCoordinate=bang.Branch2)
box = Box2Pt(PointA=pt, PointB=pt_2, Plane=PlaneXY(0, 0, 0))
geo = Geometry(box)
volume = Volume(Geometry=geo)  # -> Volume, Centroid
objective = Objective(Name="Volume", Value=volume.Volume, Goal="Maximize")
